# Grasshopper definition capture-test.gh (Grasshopper 1.0.7)
# plug-ins: Capture2, Sampler2

panel = Panel("C:\Users\harry\Desktop\New folder 5")
number_slider = Slider(5.689, range=1..10)
number_slider_2 = Slider(9.095, range=1..10)
number_slider_3 = Slider(2.263, range=1..10)
panel_2 = Panel("sds")
panel_3 = Panel("0")
sampler = Sampler(
    Variables=[number_slider_2, number_slider, number_slider_3],
    Samples="10",
    Type=0,
    Seed=123,
    Filename="testncb-01",
    Directory=panel)  # -> DesignMap, Data
domain_box = DomainBox(Base=PlaneXY(0, 0, 0), X=number_slider_2, Y=number_slider, Z=number_slider_3)
panel_4 = Panel(sampler.Data)
panel_5 = Panel(sampler.DesignMap)
mass_addition = MassAddition(Input=[number_slider_2, number_slider, number_slider_3])  # -> Result, PartialResults
concatenate = Concatenate(FragmentA=mass_addition.Result, FragmentB="haha")
concatenate_2 = Concatenate(FragmentA="yesyes", FragmentB=mass_addition.Result)
panel_6 = Panel(concatenate)
panel_7 = Panel(concatenate_2)
capture = Capture(
    Variables=[number_slider_2, number_slider, number_slider_3],
    Objectives=mass_addition.Result,
    Mode=2,
    Properties=[concatenate, concatenate_2],
    DesignMap=sampler.DesignMap,
    CsvFilename="data",
    CsvDirectory=panel,
    ScreenshotFilename="screenshot",
    ScreenshotDirectory=panel,
    BackupFrequency="3")  # -> DesignMapObjectives, CapturedProperties, Data, Images
panel_8 = Panel([capture.Data, capture.Images])
